# Grasshopper definition hopsFaceMesh.gh (Grasshopper 1.0.7)
# plug-ins: Hops, Human, Pufferfish

trigger = Trigger(Interval=200, TimerInterval=200, Target=hops)  # disabled
hops = Hops(
    CacheResultsInMemory=False,
    CacheSolveResults=False,
    RemoteDefinitionLocation="http://127.0.0.1:5000/facemesh",
    RemoteSolveVersion=(0, 1, 0),
    ShowInput_Enabled=False,
    ShowInput_Path=False,
    SynchronousSolve=True)
delaunay_mesh = DelaunayMesh(Points=hops, Plane=PlaneXY(0, 0, 0))
bounding_box = BoundingBox(Content=delaunay_mesh, Plane=PlaneXY(0, 0, 0), UnionBox=True)  # -> Box, Box_2
area = Area(Geometry=bounding_box.Box)  # -> Area, Centroid
delaunay_edges = DelaunayEdges(Points=hops, Plane=PlaneXY(0, 0, 0))  # -> Connectivity, Edges
rotate_euler = RotateEuler(Geometry=delaunay_mesh, Plane=area.Centroid, Axis1=0, Axis2=1, Axis3=2, Degrees1="-90", Degrees2=0, Degrees3=0)  # -> Rotated, Plane1, Plane2, Plane3, Transform
rotate_euler_2 = RotateEuler(Geometry=delaunay_edges.Edges, Plane=area.Centroid, Axis1=0, Axis2=1, Axis3=2, Degrees1="-90", Degrees2=0, Degrees3=0)  # -> Rotated, Plane1, Plane2, Plane3, Transform
create_material = CreateMaterial(
    Diffuse=ColourSwatch(SwatchColor=RGB(252, 252, 252)),
    Specular=RGB(255, 254, 254),
    Emission=RGB(0, 0, 0),
    Transparency=0,
    Shine=0)
custom_preview_lineweights = CustomPreviewLineweights(
    Geometry=rotate_euler_2.Rotated,
    Shader=ColourSwatch(SwatchColor=RGB(42, 0, 255)),
    Thickness=Slider(1, range=0.001..1),
    Absolute=False)
custom_preview = CustomPreview(Geometry=rotate_euler.Rotated, Material=create_material)
