# Grasshopper definition hopsHandTracking.gh (Grasshopper 1.0.7)
# plug-ins: Hops, Human

trigger = Trigger(Interval=500, TimerInterval=500, Target=hops)
thumb_tip = Panel("4")
index_finger_tip = Panel("8")
unit_z = UnitZ(Factor=1)
xy_plane = XYPlane(Origin=Point(0, 0, 0))
hops = Hops(
    Landmark1=thumb_tip,
    Landmark2=index_finger_tip,
    CacheResultsInMemory=False,
    CacheSolveResults=False,
    RemoteDefinitionLocation="http://127.0.0.1:5000/handtest",
    RemoteSolveVersion=(0, 1, 0),
    ShowInput_Enabled=False,
    ShowInput_Path=False,
    SynchronousSolve=True)
line_sdl = LineSDL(Start=xy_plane, Direction=unit_z, Length=Slider(5, range=1..10))
distance = Panel(hops)
min = Panel("60")
max = Panel("400")
smaller_than = SmallerThan(FirstNumber=distance, SecondNumber=0)  # -> SmallerThan, OrEqualTo
construct_domain = ConstructDomain(DomainStart=min, DomainEnd=max)
remap_numbers = RemapNumbers(Value=distance, Source=construct_domain, Target=Domain(0, 1))  # -> Mapped, Clipped
stream_gate = StreamGate(Stream=line_sdl, Gate=smaller_than.SmallerThan)  # -> Target0, Target1
evaluate_curve = EvaluateCurve(Curve=reparameterize(stream_gate.Target0), Parameter=remap_numbers.Clipped)  # -> Point, Tangent, Angle
colour_swatch = ColourSwatch(SwatchColor=RGB(89, 255, 0))
sphere = Sphere(Base=evaluate_curve.Point, Radius=Slider(0.15, range=0..0.5))
custom_preview_lineweights = CustomPreviewLineweights(
    Geometry=stream_gate.Target1,
    Shader=ColourSwatch(SwatchColor=RGB(255, 0, 0)),
    Thickness=Slider(6, range=0..10),
    Absolute=False)
custom_preview_lineweights_2 = CustomPreviewLineweights(Geometry=stream_gate.Target0, Shader=colour_swatch, Thickness=Slider(6, range=0..10), Absolute=False)
custom_preview = CustomPreview(Geometry=sphere, Material=colour_swatch)
